# Dynamo graph RevitMetaDataExporter.dyn (Dynamo 2.1.0.7500)

# group: DYNAMIC METADA EXPORTER
# note: NOTES:
# 1. Requires use of shared parameters
# 2. Load DynamicParameterExport.txt initially into project
# 3. Default parameters are length, area, perimeter, volume, and thickness are to be copied to designated export parameter

# group: USER INTERFACE
# note: User Input

# group: LENGTH PARAMETER
# note: Selected Element --> Length Export Parameter

# group: AREA PARAMETER
# note: Selected Element --> Area Export Parameter

# group: VOLUME PARAMETER
# note: Selected Element --> Volume Export Parameter

# group: PERIMETER PARAMETER
# note: Selected Element --> Perimeter Export Parameter

# group: THICKNESS PARAMETER
# note: Selected Element --> Thickness Export Parameter

# group: Select Desired Elements for Outputting Dynamic Metadata
select_model_elements = DSModelElementsSelection()  # 7 picked in the model

# group: Backend Process
code_block = CodeBlock { "Volume"; }
# note: Retrieve element default dynamic instance parameter.
getParameterValueByName = Element.GetParameterValueByName(element=select_model_elements, parameterName=code_block)

# group: Output to UI
code_block_2 = CodeBlock { "Volume Export"; }
# note: Assign default dynamic instance parameter to shared export parameter.
setParameterByName = Element.SetParameterByName(element=select_model_elements, parameterName=code_block_2, value=getParameterValueByName)

# group: Output
# note: Monitor Affected Elements
watch = Watch(setParameterByName)

# group: Backend Process
code_block_3 = CodeBlock { "Length"; }
# note: Retrieve element default dynamic instance parameter.
getParameterValueByName_2 = Element.GetParameterValueByName(element=select_model_elements, parameterName=code_block_3)

# group: Output to UI
code_block_4 = CodeBlock { "Length Export"; }
# note: Assign default dynamic instance parameter to shared export parameter.
setParameterByName_2 = Element.SetParameterByName(element=select_model_elements, parameterName=code_block_4, value=getParameterValueByName_2)

# group: Output
# note: Monitor Affected Elements
watch_2 = Watch(setParameterByName_2)

# group: Backend Process
code_block_5 = CodeBlock { "Perimeter"; }
# note: Retrieve element default dynamic instance parameter.
getParameterValueByName_3 = Element.GetParameterValueByName(element=select_model_elements, parameterName=code_block_5)

# group: Output to UI
code_block_6 = CodeBlock { "Perimeter Export"; }
# note: Assign default dynamic instance parameter to shared export parameter.
setParameterByName_3 = Element.SetParameterByName(element=select_model_elements, parameterName=code_block_6, value=getParameterValueByName_3)

# group: Output
# note: Monitor Affected Elements
watch_3 = Watch(setParameterByName_3)

# group: Backend Process
code_block_7 = CodeBlock { "Thickness"; }
# note: Retrieve element default dynamic instance parameter.
getParameterValueByName_4 = Element.GetParameterValueByName(element=select_model_elements, parameterName=code_block_7)

# group: Output to UI
code_block_8 = CodeBlock { "Thickness Export"; }
# note: Assign default dynamic instance parameter to shared export parameter.
setParameterByName_4 = Element.SetParameterByName(element=select_model_elements, parameterName=code_block_8, value=getParameterValueByName_4)

# group: Output
# note: Monitor Affected Elements
watch_4 = Watch(setParameterByName_4)

# group: Backend Process
code_block_9 = CodeBlock { "Area"; }
# note: Retrieve element default dynamic instance parameter.
getParameterValueByName_5 = Element.GetParameterValueByName(element=select_model_elements, parameterName=code_block_9)

# group: Output to UI
code_block_10 = CodeBlock { "Area Export"; }
# note: Assign default dynamic instance parameter to shared export parameter.
setParameterByName_5 = Element.SetParameterByName(element=select_model_elements, parameterName=code_block_10, value=getParameterValueByName_5)

# group: Output
# note: Monitor Affected Elements
watch_5 = Watch(setParameterByName_5)
